vi "Binary Search 1D Array (friendly fraction).gvi"   [LabVIEW NXG 3.1.0]
# This is a binary search through a 1D array. It has no start index input and searches the entire array for the element requested.
# If found, the index of the match is returned. If not found, an index of -1 is returned.
# Due to the nature of the binary search, your input array must already be sorted. This function will not sort your array, so if you send in an unsorted array, it will not function properly. Furthermore, if you have duplicate elements in your array, it is not guaranteed that the index returned will be to the match with the lowest array element number.
# This is the double-precision floating-point (DBL) portion of the polymorphic VI.
inputs:
  "1D array": "Friendly fraction.gtype"[], required
  "element": f64, required
outputs:
  "index": i32
diagram:
  Array Size(array=$"1D array") -> (size(s)=w1)
  Decrement(x=w1) -> w2
  # Converted and modified from http://www.ni.com/example/25220/en/
  s1 = w2  # shift register
  s2 = 0  # shift register
  while {
    # high
    # low
    Add(s1, s2) -> w3
    w4 = -1  # divide by 2
    Logical Shift(x=w3, y=w4) -> w5
    Array Index(array=$"1D array") -> (out0[w5]=w6)
    Property Node(instance in=w6) -> ("Double"=w7)
    Is Less(x=w7, y=$element) -> w8
    case (w8) {
      frame False, Default {
        Decrement(x=w5) -> w9
        w10 = s2
      }
      frame True {
        Increment(x=w5) -> w10
        w9 = s1
      }
    }
    Is Equal(x=w7, y=$element) -> w11
    Is Greater(x=s2, y=s1) -> w12
    Logical Or(w12, w11) -> w13
    next s1 = w9
    next s2 = w10
    stop if w13
  }
  # Algorithm:
  # Set low & high indicies to 0 and
  # (array_size - 1) respectively.
  # Each iteration, do (low + high) / 2
  # to find the new midpoint.  If the
  # current element is less than the
  # one being searched for, set low
  # to (current + 1), else set high to
  # (current - 1).  Stop when found
  # or when low > high.  Return the
  # index if found, or -1 otherwise.
  # Index Array returns default data for the array's data type (0 for numbers, empty string for strings, etc).
  # When the search finishes and the bit shift rolls over to 2147483647 (-1 >> 1), if you happened to be
  # searching for the default data for that type, this index is returned as an incorrect match.  So added a
  # check to first verify that the match index is less than the array size, otherwise return -1 (no match).
  disable {
    frame Enabled {
      # modified to return the found index
      # or one where array[low] is the greatest
      # member less than element
      w14 = w5
    }
    frame Disabled {
      Is Less(x=w5, y=w1) -> w15
      Logical And(w11, w15) -> w16
      Select(s=w16, t=w5, f=-1) -> w14
    }
  }
  $index <- w14
