vi "Binary Search 1D Array.gvi"   [LabVIEW NXG 4.0.0]
# This is a binary search through a 1D array. It has no start index input and searches the entire array for the element requested.
# If found, the index of the match is returned. If not found, an index of -1 is returned.
# Due to the nature of the binary search, your input array must already be sorted. This function will not sort your array, so if you send in an unsorted array, it will not function properly. Furthermore, if you have duplicate elements in your array, it is not guaranteed that the index returned will be to the match with the lowest array element number.
# This is the double-precision floating-point (DBL) portion of the polymorphic VI.
inputs:
  "Sorted 1D array": f64[], required
  "element": f64, required
outputs:
  "index": i32
diagram:
  Array Size(array=$"Sorted 1D array") -> (size(s)=w1)
  Decrement(x=w1) -> w2
  # Converted and modified from http://www.ni.com/example/25220/en/
  s1 = w2  # shift register
  s2 = 0  # shift register
  while {
    # high
    # low
    Add(s1, s2) -> w3
    w4 = -1  # divide by 2
    Logical Shift(x=w3, y=w4) -> w5
    Array Index(array=$"Sorted 1D array") -> (out0[w5]=w6)
    Is Less(x=w6, y=$element) -> w7
    case (w7) {
      frame False, Default {
        Decrement(x=w5) -> w8
        w9 = s2
      }
      frame True {
        Increment(x=w5) -> w9
        w8 = s1
      }
    }
    Is Equal(x=w6, y=$element) -> w10
    Is Greater(x=s2, y=s1) -> w11
    Logical Or(w11, w10) -> w12
    next s1 = w8
    next s2 = w9
    stop if w12
  }
  # Algorithm:
  # Set low & high indicies to 0 and
  # (array_size - 1) respectively.
  # Each iteration, do (low + high) / 2
  # to find the new midpoint.  If the
  # current element is less than the
  # one being searched for, set low
  # to (current + 1), else set high to
  # (current - 1).  Stop when found
  # or when low > high.  Return the
  # index if found, or -1 otherwise.
  # Index Array returns default data for the array's data type (0 for numbers, empty string for strings, etc).
  # When the search finishes and the bit shift rolls over to 2147483647 (-1 >> 1), if you happened to be
  # searching for the default data for that type, this index is returned as an incorrect match.  So added a
  # check to first verify that the match index is less than the array size, otherwise return -1 (no match).
  disable {
    frame Enabled {
      # modified to return the found index
      # or one where array[low] is the greatest
      # member less than element
      w13 = w5
    }
    frame Disabled {
      Is Less(x=w5, y=w1) -> w14
      Logical And(w10, w14) -> w15
      Select(s=w15, t=w5, f=-1) -> w13
    }
  }
  $index <- w13
