vi "Create.gvi"   [LabVIEW NXG 3.1.0]
inputs:
  "Denominator": u8, required
  "Numerator": u8, required
outputs:
  "Friendly fraction": "Friendly fraction.gtype"
diagram:
  Divide(x=$Numerator, y=$Denominator) -> w1
  Property Node(instance in="Friendly fraction.gtype" constant, "Double"=w1, "Numerator"=$Numerator, "Denominator"=$Denominator) -> (instance out=w2)
  $"Friendly fraction" <- w2
