vi "Make friendly fractions.gvi"   [LabVIEW NXG 3.1.0]
outputs:
  "Friendly fractions": "Friendly fraction.gtype"[]
uses:
  NI::Analysis::SpecialFunc::GCD.gvi
  Gregstoll::ProbabilityToFriendlyString::Friendly fraction.gtype::Create.gvi
diagram:
  for (N = 9) (iteration -> i1) {
    Add(i1, 2) -> w2
    Decrement(x=w2) -> w3
    for (N = w3) (iteration -> i2) {
      Increment(x=i2) -> w5
      call "GCD.gvi"(x=w5, y=w2) -> (GCD(x, y)=w6)
      Is Equal(x=w6, y=1) -> w7
      case (w7) {
        frame False, Default {
          w8 = default
        }
        frame True {
          call "Create.gvi"(Numerator=w5, Denominator=w2) -> (Friendly fraction=w8)
        }
      }
      append w8 to w4 if w7
    }
    concatenate w4 onto w1
  }
  for {
    w9 = each element of [12, 15, 20, 30, 40, 50, 60, 80, 100]
    call "Create.gvi"(Numerator=1, Denominator=w9) -> (Friendly fraction=w12)
    Decrement(x=w9) -> w13
    call "Create.gvi"(Numerator=w13, Denominator=w9) -> (Friendly fraction=w14)
    append w12 to w10
    append w14 to w11
  }
  Build Array(w1, w10, w11) -> w15
  Sort 1D Array(array=w15) -> (sorted array=w16)
  $"Friendly fractions" <- w16
