vi "To Friendly probability.gvi"   [LabVIEW NXG 3.1.0]
inputs:
  "Friendly fraction in": "Friendly fraction.gtype", required
outputs:
  "FriendlyProbability out": "Friendly probability.gtype"
  "Friendly fraction out": "Friendly fraction.gtype"
uses:
  Gregstoll::ProbabilityToFriendlyString::Friendly probability.gtype::Create.gvi
diagram:
  Property Node(instance in=$"Friendly fraction in") -> ("Numerator"=w1, "Denominator"=w2, instance out=w3)
  $"Friendly fraction out" <- w3
  call "Create.gvi"(Numerator=w1, Denominator=w2) -> (FriendlyProbability out=w4)
  $"FriendlyProbability out" <- w4
