vi "Create.gvi"   [LabVIEW NXG 3.1.0]
inputs:
  "Numerator": u8, required
  "Denominator": u8 = 1, required
  "Friendly String": string
outputs:
  "FriendlyProbability out": "Friendly probability.gtype"
diagram:
  Format Into String(formatString="%d in %d", $Numerator, $Denominator) -> w1
  Is Empty String Or Path(string/path=$"Friendly String") -> w2
  Select(s=w2, t=w1, f=$"Friendly String") -> w3
  Property Node(instance in="Friendly probability.gtype" constant, "Numerator"=$Numerator, "Denominator"=$Denominator, "Friendly String"=w3) -> (instance out=w4)
  $"FriendlyProbability out" <- w4
