vi "From double core.gvi"   [LabVIEW NXG 3.1.0]
inputs:
  "Probability": f64, required
outputs:
  "Friendly Probability out": "Friendly probability.gtype"
uses:
  Gregstoll::ProbabilityToFriendlyString::Friendly fraction.gtype::Make friendly fractions.gvi
  Gregstoll::ProbabilityToFriendlyString::Binary Search 1D Array (friendly fraction).gvi
  Gregstoll::ProbabilityToFriendlyString::Friendly fraction.gtype::To Friendly probability.gvi
diagram:
  # Assumes the probability is between 0.01 and 0.99
  s1 = uninitialised  # shift register
  while {
    Array Size(array=s1) -> (size(s)=w1)
    Is Equal To 0(x=w1) -> w2
    case (w2) {
      frame False, Default {
        w3 = s1
      }
      frame True {
        call "Make friendly fractions.gvi"() -> (Friendly fractions=w3)
      }
    }
    call "Binary Search 1D Array (friendly fraction).gvi"(1D array=w3, element=$Probability) -> (index=w4)
    Array Size(array=w3) -> (size(s)=w5)
    Decrement(x=w5) -> w6
    Is Less(x=w4, y=w6) -> w7
    case (w7) {
      frame False, Default {
        w8 = w6
      }
      frame True {
        Increment(x=w4) -> w9
        Array Index(array=w3) -> (out0[w4]=w10)
        Property Node(instance in=w10) -> ("Double"=w11)
        Subtract(x=$Probability, y=w11) -> w12
        Absolute Value(x=w12) -> w13
        Array Index(array=w3) -> (out0[w9]=w14)
        Property Node(instance in=w14) -> ("Double"=w15)
        Subtract(x=$Probability, y=w15) -> w16
        Absolute Value(x=w16) -> w17
        Is Less(x=w17, y=w13) -> w18
        Select(s=w18, t=w9, f=w4) -> w8
      }
    }
    Array Index(array=w3) -> (out0[w8]=w19)
    next s1 = w3
    stop if TRUE
  }
  call "To Friendly probability.gvi"(Friendly fraction in=w19) -> (FriendlyProbability out=w20)
  $"Friendly Probability out" <- w20
