vi "From double.gvi"   [LabVIEW NXG 4.0.0]
inputs:
  "Probability": f64, required
outputs:
  "Error Out": error
  "Friendly Probability out": "Friendly probability.gtype"
uses:
  NI::G Core::Error::Build Error Cluster.gvi
  Gregstoll::ProbabilityToFriendlyString::Friendly probability.gtype::From double core.gvi
  Gregstoll::ProbabilityToFriendlyString::Friendly probability.gtype::Create.gvi
  Gregstoll::ProbabilityToFriendlyString::Friendly probability.gtype::Get Friendly Description.gvi
diagram:
  In Range And Coerce[IncludeHighLimit=True](lower limit=0, upper limit=1, x=$Probability) -> (In Range?=w1)
  case (w1) {
    frame False, Default {
      Format Into String(formatString="Probability %d must be between 0 and 1!", $Probability) -> w4
      call "Build Error Cluster.gvi"(code=1, description=w4) -> (error out=w2)
      w3 = default
    }
    frame True {
      w5 = no error  # Error
      Is Greater(x=$Probability, y=0.99) -> w6
      case (w6) {
        frame False, Default {
          Is Less(x=$Probability, y=0.01) -> w8
          case (w8) {
            frame False, Default {
              call "From double core.gvi"(Probability=$Probability) -> (Friendly Probability out=w7)
            }
            frame True {
              Is Equal(x=$Probability, y=0) -> w9
              call "Create.gvi"(Numerator=0, Denominator=1) -> (FriendlyProbability out=w10)
              call "Create.gvi"(Numerator=1, Denominator=100, Friendly String="<1 in 100") -> (FriendlyProbability out=w11)
              Select(s=w9, t=w10, f=w11) -> w7
            }
          }
        }
        frame True {
          Is Equal(x=$Probability, y=1) -> w12
          call "Create.gvi"(Numerator=1, Denominator=1) -> (FriendlyProbability out=w13)
          call "Create.gvi"(Numerator=99, Denominator=100, Friendly String=">99 in 100") -> (FriendlyProbability out=w14)
          Select(s=w12, t=w13, f=w14) -> w7
        }
      }
      call "Get Friendly Description.gvi"(Numeric=$Probability) -> (friendly description=w15)
      Property Node(instance in=w7, "Friendly Description"=w15) -> (instance out=w3)
      w2 = w5
    }
  }
  $"Error Out" <- w2
  $"Friendly Probability out" <- w3
