vi "Get Friendly Description.gvi"   [LabVIEW NXG 4.0.0]
inputs:
  "Numeric": f64, required
outputs:
  "friendly description": string
uses:
  Gregstoll::ProbabilityToFriendlyString::Binary Search 1D Array.gvi
diagram:
  w1 = [0, 0.005, 0.02, 0.08, 0.15, 0.2, 0.45, 0.55, 0.7, 0.8, 0.85, 0.9, 0.95, 0.995]
  call "Binary Search 1D Array.gvi"(Sorted 1D array=w1, element=$Numeric) -> (index=w2)
  w3 = ["Hard to imagine", "Barely possible", "Still possible", "Some chance", "Could happen", "Perhaps", "Flip a coin", "Likelier than not", "Good chance", "Probably", "Quite likely", "Pretty likely", "Very likely", "Almost certainly"]
  Array Index(array=w3) -> (out0[w2]=w4)
  $"friendly description" <- w4
