vi "To string.gvi"   [LabVIEW NXG 3.1.0]
inputs:
  "Friendly Probability": "Friendly probability.gtype", required
outputs:
  "string": string
diagram:
  Property Node(instance in=$"Friendly Probability") -> ("Numerator"=w1, "Denominator"=w2, "Friendly String"=w3)
  Format Into String(formatString="%d/%d (text: \"%s\")", w1, w2, w3) -> w4
  $string <- w4
