vi "Parse test case.gvi"   [LabVIEW NXG 3.1.0]
inputs:
  "Line number": u32, required
  "Line": string, required
outputs:
  "Is valid?": bool
  "Test case": "Test case.gtype"
  "Error Out": error
types:
  "Test case.gtype" = cluster{"Probability": f64, "Expected Friendly Probability": "Friendly probability.gtype", "Line number": u32}
uses:
  NI::G Core::Strings::Trim Whitespace.gvi
  NI::G Core::Strings::Delimited String to 1D String Array.gvi
  Gregstoll::ProbabilityToFriendlyString::Friendly probability.gtype::Create.gvi
  NI::G Core::Error::Build Error Cluster.gvi
diagram:
  call "Trim Whitespace.gvi"(string=$Line) -> (trimmed string=w1)
  String Length(string=w1) -> (length=w2)
  Is Equal To 0(x=w2) -> w3
  String Subset(length (rest)=1, string=w1) -> w4
  Is Equal(x=w4, y="#") -> w5
  Logical Or(w3, w5) -> w6
  case (w6) {
    frame False, Default {
      call "Delimited String to 1D String Array.gvi"(delimited string=w1, delimiter=",") -> (string array=w10)
      Array Size(array=w10) -> (size(s)=w11)
      case (w11) {
        frame 3 {
          Array Index(array=w10) -> (out0[_]=w12, out1[_]=w13, out2[_]=w14)
          Floating Point String To Number(string=w12) -> (number=w15)
          Decimal String To Number(string=w13) -> (number=w16)
          Decimal String To Number(string=w14) -> (number=w17)
          call "Create.gvi"(Numerator=w16, Denominator=w17) -> (FriendlyProbability out=w18)
          Property Node(instance in="Test case.gtype" {all zero or empty}, "Probability"=w15, "Expected Friendly Probability"=w18, "Line number"=$"Line number") -> (instance out=w8)
          w9 = no error
          w7 = TRUE
        }
        frame 4 {
          Array Index(array=w10) -> (out0[_]=w19, out1[_]=w20, out2[_]=w21, out3[_]=w22)
          Floating Point String To Number(string=w19) -> (number=w23)
          Decimal String To Number(string=w20) -> (number=w24)
          Decimal String To Number(string=w21) -> (number=w25)
          call "Create.gvi"(Numerator=w24, Denominator=w25, Friendly String=w22) -> (FriendlyProbability out=w26)
          Property Node(instance in="Test case.gtype" {all zero or empty}, "Probability"=w23, "Expected Friendly Probability"=w26, "Line number"=$"Line number") -> (instance out=w8)
          w9 = no error
          w7 = TRUE
        }
        frame Default {
          Format Into String(formatString="Line %d in testCases.txt is malformed: \"%s\"", $"Line number", w1) -> w27
          call "Build Error Cluster.gvi"(code=1, description=w27) -> (error out=w9)
          w8 = "Test case.gtype" {all zero or empty}
          w7 = FALSE
        }
      }
    }
    frame True {
      w7 = FALSE
      w8 = "Test case.gtype" {all zero or empty}
      w9 = no error
    }
  }
  $"Is valid?" <- w7
  $"Test case" <- w8
  $"Error Out" <- w9
