vi "Read test cases friendly description.gvi"   [LabVIEW NXG 4.0.0]
outputs:
  "error out": error
  "test cases": "Test case friendly description.gtype"[]
panel indicators:
  "lines": string[]
types:
  "Test case friendly description.gtype" = cluster{"Probability": f64, "Line number": u32, "Expected friendly description": string}
uses:
  NI::G Core::File IO (General)::Is Path and Not Empty.gvi
  NI::G Core::Strings::Delimited String to 1D String Array.gvi
  Gregstoll::ProbabilityToFriendlyStringTests::Trim and should filter line.gvi
diagram:
  Get Component Directory() -> (Path=w1)
  s1 = w1  # shift register
  while {
    Strip Path(path=s1) -> (stripped path=w2)
    call "Is Path and Not Empty.gvi"(path=w2) -> (path and not empty?=w3)
    Build Path(base path=s1, name or relative path="testCases.friendlyDescription.txt") -> (appended path=w4)
    Read From Text File(file (use dialog)=w4) -> (error out=w5, text=w6)
    Logical Or(not w3, not w5) -> w7
    next s1 = w2
    stop if w7
  }
  call "Delimited String to 1D String Array.gvi"(delimited string=w6, delimiter="\n") -> (string array=w8)
  for (iteration -> i1) {
    w9 = each element of w8
    call "Trim and should filter line.gvi"(Line=w9) -> (Line out=w11, should skip?=w12)
    call "Delimited String to 1D String Array.gvi"(delimited string=w11, delimiter=",") -> (string array=w13)
    Array Index(array=w13) -> (out0[_]=w14, out1[_]=w15)
    Floating Point String To Number(string=w14) -> (number=w16)
    Property Node(instance in="Test case friendly description.gtype" {all zero or empty}, "Probability"=w16, "Line number"=i1, "Expected friendly description"=w15) -> (instance out=w17)
    Not(x=w12) -> w18
    append w17 to w10 if w18
  }
  $"test cases" <- w10
  $lines <- w8
  $"error out" <- w5
