vi "Read test cases.gvi"   [LabVIEW NXG 3.1.0]
outputs:
  "error out": error
  "test cases": "Test case.gtype"[]
panel indicators:
  "lines": string[]
types:
  "Friendly Probability.gtype" = cluster{"Numerator": u8, "Denominator": u8, "Friendly String": string}
  "Test case.gtype" = cluster{"Probability": f64, "Expected Friendly Probability": "Friendly Probability.gtype", "Line number": u32}
uses:
  NI::G Core::File IO (General)::Is Path and Not Empty.gvi
  NI::G Core::Strings::Delimited String to 1D String Array.gvi
  Gregstoll::ProbabilityToFriendlyStringTests::Parse test case.gvi
diagram:
  Get Component Directory() -> (Path=w1)
  s1 = w1  # shift register
  while {
    Build Path(base path=s1, name or relative path="testCases.txt") -> (appended path=w2)
    Read From Text File(file (use dialog)=w2) -> (error out=w3, text=w4)
    Strip Path(path=s1) -> (stripped path=w5)
    call "Is Path and Not Empty.gvi"(path=w5) -> (path and not empty?=w6)
    Logical Or(not w6, not w3) -> w7
    next s1 = w5
    stop if w7
  }
  call "Delimited String to 1D String Array.gvi"(delimited string=w4, delimiter="\n") -> (string array=w8)
  $lines <- w8
  for (iteration -> i1) {
    w9 = each element of w8
    call "Parse test case.gvi"(Line=w9, Line number=i1) -> (Test case=w12, Is valid?=w13, Error Out=w14)
    append w14 to w10
    append w12 to w11 if w13
  }
  $"test cases" <- w11
  Merge Errors(w3, w10) -> (error out=w15)
  $"error out" <- w15
