vi "Run tests.gvi"   [LabVIEW NXG 4.0.0]
outputs:
  "pass?": bool
  "Errors": string[]
panel indicators:
  "error out": error
uses:
  Gregstoll::ProbabilityToFriendlyStringTests::Read test cases.gvi
  Gregstoll::ProbabilityToFriendlyStringTests::Read test cases friendly description.gvi
  Gregstoll::ProbabilityToFriendlyString::Friendly probability.gtype::From double.gvi
  Gregstoll::ProbabilityToFriendlyString::Friendly probability.gtype::To string.gvi
diagram:
  call "Read test cases.gvi"() -> (test cases=w1, error out=w2)
  call "Read test cases friendly description.gvi"() -> (test cases=w3)
  for {
    w4 = each element of w3
    Property Node(instance in=w4) -> ("Probability"=w7, "Expected friendly description"=w8, "Line number"=w9)
    call "From double.gvi"(Probability=w7) -> (Friendly Probability out=w10, Error Out=w11)
    Property Node(instance in=w10) -> ("Friendly Description"=w12)
    Is Equal[ComparisonMode=CompareAggregates](x=w12, y=w8) -> w13
    case (w13) {
      frame False, Default {
        w16 = "friendly probability expected %s actual %s for %f line number %d"
        Format Into String(formatString=w16, w8, w12, w7, w9) -> w14
        w15 = TRUE
      }
      frame True {
        w14 = ""
        w15 = FALSE
      }
    }
    append w11 to w5
    append w14 to w6 if w15
  }
  for {
    w17 = each element of w1
    Property Node(instance in=w17) -> ("Probability"=w20, "Expected Friendly Probability"=w21, "Line number"=w22)
    call "From double.gvi"(Probability=w20) -> (Friendly Probability out=w23, Error Out=w24)
    Property Node(instance in=w21) -> ("Numerator"=w25, "Denominator"=w26, "Friendly String"=w27)
    Build Cluster(w25, w26, w27) -> w28
    Property Node(instance in=w23) -> ("Numerator"=w29, "Denominator"=w30, "Friendly String"=w31)
    Build Cluster(w29, w30, w31) -> w32
    Is Equal[ComparisonMode=CompareAggregates](x=w28, y=w32) -> w33
    case (w33) {
      frame True {
        w34 = FALSE
        w35 = ""
      }
      frame False {
        call "To string.gvi"(Friendly Probability=w23) -> (string=w36)
        call "To string.gvi"(Friendly Probability=w21) -> (string=w37)
        Format Into String(formatString="expected %s actual %s for %f line number %d", w37, w36, w20, w22) -> w35
        w34 = TRUE
      }
    }
    append w24 to w18
    append w35 to w19 if w34
  }
  Merge Errors(w2, w18, w5) -> (error out=w38)
  $"error out" <- w38
  Build Array(w19, w6) -> w39
  Array Size(array=w39) -> (size(s)=w40)
  Is Greater Than 0(x=w40) -> w41
  Logical Or[output inverted](w38, w41) -> w42
  $"pass?" <- w42
  $Errors <- w39
