vi "Trim and should filter line.gvi"   [LabVIEW NXG 4.0.0]
inputs:
  "Line": string, required
outputs:
  "should skip?": bool
  "Line out": string
uses:
  NI::G Core::Strings::Trim Whitespace.gvi
diagram:
  call "Trim Whitespace.gvi"(string=$Line) -> (trimmed string=w1)
  String Length(string=w1) -> (length=w2)
  Is Equal To 0(x=w2) -> w3
  String Subset(length (rest)=1, string=w1) -> w4
  Is Equal(x=w4, y="#") -> w5
  Logical Or(w3, w5) -> w6
  $"should skip?" <- w6
  $"Line out" <- w1
